# Dynamo graph Duplicate Views - Label.dyn (Dynamo 1.3.3.4111)

# group: Start Here
document_views = Python()  # unwired: IN[0]
# ---------- document_views.python (19 lines) ----------
import clr
clr.AddReference('RevitAPI')
from Autodesk.Revit.DB import *
import Autodesk

clr.AddReference("RevitServices")
import RevitServices
from RevitServices.Persistence import DocumentManager

doc = DocumentManager.Instance.CurrentDBDocument
collector = FilteredElementCollector(doc)
views = collector.OfClass(View).ToElements()
viewlist = list()

for view in views:
	if (view.ViewType == ViewType.FloorPlan or view.ViewType == ViewType.CeilingPlan) and not(view.IsTemplate):
			viewlist.append(view)

OUT = viewlist
# ----------------------------------------
filter_parameter_name = StringInput("dynamo")
getParameterValueByName = Element.GetParameterValueByName(element=document_views, parameterName=filter_parameter_name)
filter_parameter_value = StringInput("base")
eq = getParameterValueByName == filter_parameter_value
filterByBoolMask = List.FilterByBoolMask(list=document_views, mask=eq)

view_template_name = StringInput("Architectural")

# group: View Name
is_suffix = BoolSelector(true)
code_block = CodeBlock { "View Name"; }
getParameterValueByName_2 = Element.GetParameterValueByName(element=filterByBoolMask.in, parameterName=code_block)
code_block_2 = CodeBlock(IsSuffix=is_suffix, viewName=getParameterValueByName_2, str=view_template_name) { IsSuffix?viewName+"-"+str:str+"-"+viewName; }

duplicate_options = DuplicateOptionsUi("Duplicate")
duplicate = archilab.Revit.Views.View.Duplicate(filterByBoolMask.in, code_block_2, duplicate_options)

# group: Scope Box
code_block_3 = CodeBlock { "Scope Box"; }
categories = Categories("VolumeOfInterest")
all_elements_of_category = ElementsOfCategory(categories)
name = Element.Name(all_elements_of_category)
scope_box_name = StringInput("כל הבניין")
eq_2 = name == scope_box_name
filterByBoolMask_2 = List.FilterByBoolMask(list=all_elements_of_category, mask=eq_2)
setParameterByName = Element.SetParameterByName(element=duplicate, parameterName=code_block_3, value=filterByBoolMask_2.in)

# group: label
label_parameter = StringInput("label")
label_parameter_value = StringInput("ARC")
setParameterByName_2 = Element.SetParameterByName(element=duplicate, parameterName=label_parameter, value=label_parameter_value)

watch = Watch(document_views)
set_view_template = Python(IN[0]=duplicate, IN[1]=view_template_name)
# ---------- set_view_template.python (49 lines) ----------
#template for python nodes in dynamo 1.0
#proposed by Julien Benoit @jbenoit44 
#http://aecuandme.wordpress.com/
import clr
clr.AddReference('ProtoGeometry')
from Autodesk.DesignScript.Geometry import *
# Import ToDSType(bool) extension method
clr.AddReference("RevitNodes")
import Revit
clr.ImportExtensions(Revit.Elements)
# Import geometry conversion extension methods
clr.ImportExtensions(Revit.GeometryConversion)
# Import DocumentManager and TransactionManager
clr.AddReference("RevitServices")
import RevitServices
from RevitServices.Persistence import DocumentManager
from RevitServices.Transactions import TransactionManager
from System.Collections.Generic import *
# Import RevitAPI
clr.AddReference("RevitAPI")
import Autodesk
from Autodesk.Revit.DB import *

doc = DocumentManager.Instance.CurrentDBDocument
uiapp = DocumentManager.Instance.CurrentUIApplication
app = uiapp.Application
uidoc=DocumentManager.Instance.CurrentUIApplication.ActiveUIDocument

viewTempName = IN[1]
views = []
for i in IN[0]:
	views.append(UnwrapElement(i))

# Start Transaction
TransactionManager.Instance.EnsureInTransaction(doc)

collector = FilteredElementCollector(doc).OfClass(View)
for i in collector:
	if i.IsTemplate == True and i.Name == viewTempName:
		viewTemp = i

for i in views:
	i.ViewTemplateId = viewTemp.Id
		

# End Transaction
TransactionManager.Instance.TransactionTaskDone()

OUT=views
# ----------------------------------------
