# Dynamo graph Duplicate Views - Multi View Template.dyn (Dynamo 1.3.3.4111)

veiws_sets_view_template_name = StringInput("Architectural Plan, Structural Framing Plan, Rooms Review, Rooms Owner, תאום שלד")
code_block = CodeBlock { ", "; }
split = String.Split(veiws_sets_view_template_name, code_block)

# group: Start Here
document_views = Python()  # unwired: IN[0]
# ---------- document_views.python (20 lines) ----------
import clr
clr.AddReference('RevitAPI')
from Autodesk.Revit.DB import *
import Autodesk

clr.AddReference("RevitServices")
import RevitServices
from RevitServices.Persistence import DocumentManager

doc = DocumentManager.Instance.CurrentDBDocument
collector = FilteredElementCollector(doc)
views = collector.OfClass(View).ToElements()
viewlist = list()
for view in views:
	if view.ViewType == ViewType.ThreeD:
		if not(view.IsTemplate):
			viewlist.append(view)
	else:
		viewlist.append(view)
OUT = viewlist
# ----------------------------------------
filter_parameter_name = StringInput("dynamo")
getParameterValueByName = Element.GetParameterValueByName(element=document_views, parameterName=filter_parameter_name)
filter_parameter_value = StringInput("base")
eq = getParameterValueByName == filter_parameter_value
filterByBoolMask = List.FilterByBoolMask(list=document_views, mask=eq)

viewDuplicateByName = Custom[ViewDuplicateByName](View_Template_Name=split, view=filterByBoolMask.in, lacing=CrossProduct)

# group: SET Scope Box
code_block_2 = CodeBlock { "Scope Box"; }
categories = Categories("VolumeOfInterest")
all_elements_of_category = ElementsOfCategory(categories)
name = Element.Name(all_elements_of_category)
scope_box_name = StringInput("כל הבניין")
eq_2 = name == scope_box_name
filterByBoolMask_2 = List.FilterByBoolMask(list=all_elements_of_category, mask=eq_2)
setParameterByName = Element.SetParameterByName(element=viewDuplicateByName, parameterName=code_block_2, value=filterByBoolMask_2.in)

watch = Watch(document_views)
code_block_3 = CodeBlock { "dynamo"; }
viewduplicatebyname_with_label = Custom[ViewDuplicateByName With Label](Label_Parameter=code_block_3, view=filterByBoolMask.in, View_Set_Name=split)  # frozen
