# Dynamo graph Duplicate Views to 2 Dependent Views.dyn (Dynamo 1.3.3.4111)

filter_parameter_name = StringInput("dynamo")

# group: Get Views To Duplicate
views = Python()  # "Document.Views"; unwired: IN[0]
# ---------- views.python (19 lines) ----------
import clr
clr.AddReference('RevitAPI')
from Autodesk.Revit.DB import *
import Autodesk

clr.AddReference("RevitServices")
import RevitServices
from RevitServices.Persistence import DocumentManager

doc = DocumentManager.Instance.CurrentDBDocument
collector = FilteredElementCollector(doc)
views = collector.OfClass(View).ToElements()
viewlist = list()

for view in views:
	if (view.ViewType == ViewType.FloorPlan or view.ViewType == ViewType.CeilingPlan) and not(view.IsTemplate):
			viewlist.append(view)

OUT = viewlist
# ----------------------------------------
getParameterValueByName = Element.GetParameterValueByName(element=views, parameterName=filter_parameter_name)
filter_parameter_vlaue = StringInput("Architectural")
eq = getParameterValueByName == filter_parameter_vlaue
filterByBoolMask = List.FilterByBoolMask(list=views, mask=eq)

# group: View Name A
code_block = CodeBlock { "View Name"; }
getParameterValueByName_2 = Element.GetParameterValueByName(element=filterByBoolMask.in, parameterName=code_block)
dependent_a_view_name_suffix = StringInput("-A")
concat = String.Concat(arg1=dependent_a_view_name_suffix)  # unwired: arg0
map = List.Map(list=getParameterValueByName_2, f_x=concat)
duplicate_options = DuplicateOptionsUi("AsDependent")
duplicate = archilab.Revit.Views.View.Duplicate(filterByBoolMask.in, map, duplicate_options)
code_block_2 = CodeBlock { "Scope Box"; }

# group: Scope Box A
categories = Categories("VolumeOfInterest")
all_elements_of_category = ElementsOfCategory(categories)
name = Element.Name(all_elements_of_category)
scope_box_a = StringInput("Scope Box A")
eq_2 = name == scope_box_a
filterByBoolMask_2 = List.FilterByBoolMask(list=all_elements_of_category, mask=eq_2)
count = List.Count(getParameterValueByName_2)
ofRepeatedItem = List.OfRepeatedItem(item=filterByBoolMask_2.in, amount=count)

# group (continued): View Name A
setParameterByName = Element.SetParameterByName(element=duplicate, parameterName=code_block_2, value=ofRepeatedItem)

# group: View Name B
code_block_3 = CodeBlock { "View Name"; }
getParameterValueByName_3 = Element.GetParameterValueByName(element=filterByBoolMask.in, parameterName=code_block_3)
dependent_b_view_name_suffix = StringInput("-B")
concat_2 = String.Concat(arg1=dependent_b_view_name_suffix)  # unwired: arg0
map_2 = List.Map(list=getParameterValueByName_3, f_x=concat_2)
duplicate_options_2 = DuplicateOptionsUi("AsDependent")
duplicate_2 = archilab.Revit.Views.View.Duplicate(filterByBoolMask.in, map_2, duplicate_options_2)
code_block_4 = CodeBlock { "Scope Box"; }

# group: Scope Box B
categories_2 = Categories("VolumeOfInterest")
all_elements_of_category_2 = ElementsOfCategory(categories_2)
name_2 = Element.Name(all_elements_of_category_2)
scope_box_b = StringInput("Scope Box B")
eq_3 = name_2 == scope_box_b
filterByBoolMask_3 = List.FilterByBoolMask(list=all_elements_of_category_2, mask=eq_3)
count_2 = List.Count(map_2)
ofRepeatedItem_2 = List.OfRepeatedItem(item=filterByBoolMask_3.in, amount=count_2)

# group (continued): View Name B
setParameterByName_2 = Element.SetParameterByName(element=duplicate_2, parameterName=code_block_4, value=ofRepeatedItem_2)
