# Dynamo custom node ViewDuplicateByName.dyf (Dynamo 1.3.3.4111)
# category: My

view = Input()
View_Template_Name = Input()

# group: SET View Name
code_block = CodeBlock { "View Name"; }
getParameterValueByName = Element.GetParameterValueByName(element=view, parameterName=code_block)
code_block_2 = CodeBlock(viewName=getParameterValueByName, str=View_Template_Name) { viewName+"-"+str; }

duplicate_options = DuplicateOptionsUi("Duplicate")
duplicate = archilab.Revit.Views.View.Duplicate(view, code_block_2, duplicate_options)
view_2 = Output(duplicate)  # "view"
set_view_template = Python(IN[0]=duplicate, IN[1]=View_Template_Name)
# ---------- set_view_template.python (48 lines) ----------
#template for python nodes in dynamo 1.0
#proposed by Julien Benoit @jbenoit44 
#http://aecuandme.wordpress.com/
#edit by Eli Renzer
import clr
clr.AddReference('ProtoGeometry')
from Autodesk.DesignScript.Geometry import *
# Import ToDSType(bool) extension method
clr.AddReference("RevitNodes")
import Revit
clr.ImportExtensions(Revit.Elements)
# Import geometry conversion extension methods
clr.ImportExtensions(Revit.GeometryConversion)
# Import DocumentManager and TransactionManager
clr.AddReference("RevitServices")
import RevitServices
from RevitServices.Persistence import DocumentManager
from RevitServices.Transactions import TransactionManager
from System.Collections.Generic import *
# Import RevitAPI
clr.AddReference("RevitAPI")
import Autodesk
from Autodesk.Revit.DB import *

doc = DocumentManager.Instance.CurrentDBDocument
uiapp = DocumentManager.Instance.CurrentUIApplication
app = uiapp.Application
uidoc=DocumentManager.Instance.CurrentUIApplication.ActiveUIDocument


view = UnwrapElement(IN[0])
viewTempName = IN[1]

# Start Transaction
TransactionManager.Instance.EnsureInTransaction(doc)

collector = FilteredElementCollector(doc).OfClass(View)
for i in collector:
	if i.IsTemplate == True and i.Name == viewTempName:
		viewTemp = i

view.ViewTemplateId = viewTemp.Id
		

# End Transaction
TransactionManager.Instance.TransactionTaskDone()

OUT=view
# ----------------------------------------
